# Grasshopper definition FinalAssignment.gh (Grasshopper 1.0.7)
# plug-ins: Kangaroo2 Components, Weaverbird, Pufferfish

# ---- group: RH_IN:XZ TILT
number_slider = Slider(14, range=0..30)

# ---- group: RH_IN: SIZE
number_slider_2 = Slider(32, range=25..50)

# ---- group: RH_IN:YZ TILT
number_slider_3 = Slider(7, range=0..30)

# ---- group: RH_IN:HEIGHT
number_slider_4 = Slider(24, range=0..40)

# ----
number_slider_5 = Slider(-20, range=-20..0)
expression = Expression(x=number_slider, Expression="x*π/180")
xz_plane = XZPlane(Origin=Point(0, 0, 0))
expression_2 = Expression(x=number_slider_3, Expression="x*π/180")
polygon = Polygon(Plane=PlaneXY(0, 0, 0), Radius=number_slider_2, Segments=Slider(6, range=0..10), FilletRadius=0)  # -> Polygon, Length
unit_z = UnitZ(Factor=number_slider_5)
yz_plane = YZPlane(Origin=Point(0, 0, 0))
expression_3 = Expression(X=number_slider_2, Expression="75-x")
mesh_brep = MeshBrep(
    Brep=polygon.Polygon,
    Settings={GridMaxCount=0, GridMinCount=32, JaggedSeams=False, MaxEdgeLength=0, MinEdgeLength=0.0001, MinTolerance=0, Refine=True, RefineAngle=0, RelativeTolerance=0.65, SimplePlanes=True, Tolerance=0})
extrude = Extrude(Base=polygon.Polygon, Direction=unit_z)
expression_4 = Expression(X=number_slider_5, Y=expression_3, Expression="x*y/25")
offset_curve = OffsetCurve(Curve=polygon.Polygon, Distance=Slider(30, range=10..50), Plane=PlaneXY(0, 0, 0), Corners=1)
rotate = Rotate(Geometry=offset_curve, Angle=expression, Plane=xz_plane)  # -> Geometry, Transform
rotate_2 = Rotate(Geometry=rotate.Geometry, Angle=expression_2, Plane=yz_plane)  # -> Geometry, Transform
cap_holes = CapHoles(Brep=extrude)
unit_z_2 = UnitZ(Factor=expression_4)
triremesh = TriRemesh(Geometry=mesh_brep, Length=Slider(4, range=0..10), Iterations=25)  # -> Triangulation, Dual, Creases
explode = Explode(Curve=rotate_2.Geometry, Recursive=True)  # -> Segments, Vertices
polygon_2 = Polygon(Plane=explode.Vertices, Radius=expression_3, Segments=Slider(6, range=0..10), FilletRadius=0)  # -> Polygon, Length
extrude_2 = Extrude(Base=polygon_2.Polygon, Direction=unit_z_2)
mesh_brep_2 = MeshBrep(
    Brep=polygon_2.Polygon,
    Settings={GridMaxCount=0, GridMinCount=16, JaggedSeams=False, MaxEdgeLength=0, MinEdgeLength=0.0001, MinTolerance=0, Refine=True, RefineAngle=0, RelativeTolerance=0.65, SimplePlanes=True, Tolerance=0})
mesh = Mesh(triremesh.Triangulation)
cap_holes_2 = CapHoles(Brep=extrude_2)
number_slider_6 = Slider(2, range=0..2)
unit_z_3 = UnitZ(Factor=number_slider_6)
nakedvertices = NakedVertices(Mesh=mesh)  # -> ClothedIndex, NakedIndex, ClothedPts, NakedPts
triremesh_2 = TriRemesh(Geometry=mesh_brep_2, Length=Slider(4, range=0..10), Iterations=25)  # -> Triangulation, Dual, Creases
show = Show(G=mesh)
edgelengths = EdgeLengths(Mesh=mesh, LengthFactor=Slider(0.37, range=0..1), Strength=1)
load = Load(Point=nakedvertices.ClothedPts, ForceVector=unit_z_3, Weighting=1)
mesh_2 = Mesh(triremesh_2.Triangulation)
anchor = Anchor(Point=nakedvertices.NakedPts, Strength=10000)
unit_z_4 = UnitZ(Factor=number_slider_6)
nakedvertices_2 = NakedVertices(Mesh=mesh_2)  # -> ClothedIndex, NakedIndex, ClothedPts, NakedPts
show_2 = Show(G=mesh_2)
edgelengths_2 = EdgeLengths(Mesh=mesh_2, LengthFactor=Slider(0.37, range=0..1), Strength=1)
load_2 = Load(Point=nakedvertices_2.ClothedPts, ForceVector=unit_z_4, Weighting=1)
anchor_2 = Anchor(Point=nakedvertices_2.NakedPts, Strength=10000)
zombiesolver = ZombieSolver(GoalObjects=[edgelengths_2, show_2, load_2, anchor_2], Threshold=1e-10, Tolerance=0.01, MaxIterations=50000)  # -> I, V, O
zombiesolver_2 = ZombieSolver(GoalObjects=[edgelengths, show, load, anchor], Threshold=1e-10, Tolerance=0.01, MaxIterations=50000)  # -> I, V, O
weaverbird_s_picture_frame = WeaverbirdsPictureFrame(MeshPolylines=zombiesolver.O, Distance=5, InsetType=0)
weaverbird_s_picture_frame_2 = WeaverbirdsPictureFrame(MeshPolylines=zombiesolver_2.O, Distance=5, InsetType=0)
mesh_3 = Mesh(weaverbird_s_picture_frame_2)
mesh_4 = Mesh(weaverbird_s_picture_frame)
offset_mesh = OffsetMesh(Mesh=[mesh_3, mesh_4], Distance=number_slider_4, BothSides=False, CreateSolid=Toggle(False))
brep = Brep(cap_holes_2)
brep_2 = Brep(cap_holes)

# ---- group: RH_OUT:MESH
mesh_5 = Mesh([mesh_3, offset_mesh, mesh_4, brep, brep_2])
