# Grasshopper definition sphere.gh (Grasshopper 1.0.7)

# ---- group: RH_IN:connection
number_slider = Slider(10, range=0..10)

# ---- group: RH_IN:overall size
number_slider_2 = Slider(45, range=0..100)

# ---- group: RH_IN:thickness
number_slider_3 = Slider(2, range=0..10)

# ---- group: RH_IN:sector
number_slider_4 = Slider(7, range=0..10)

# ----
circle = Circle(Plane=PlaneXY(0, 0, 0), Radius=number_slider_2)
divide_curve = DivideCurve(Curve=circle, Count=number_slider, Kinks=False)  # -> Points, Tangents, Parameters
list_item = ListItem(List=divide_curve.Points, Index=0, Wrap=True)
xz_plane = XZPlane(Origin=list_item)
line = Line(StartPoint=circle, EndPoint=divide_curve.Points)

# ---- group: RH_IN:inner size
point_on_curve = PointOnCurve(line, parameter=0.574)

# ----
circle_2 = Circle(Plane=xz_plane, Radius=number_slider_3)
circle_3 = Circle(Plane=PlaneXY(0, 0, 0), Radius=point_on_curve)
sweep1 = Sweep1(Rail=circle, Sections=circle_2, Miter=1)
plane_normal = PlaneNormal(Origin=point_on_curve, ZAxis=line)
plane_normal_2 = PlaneNormal(Origin=divide_curve.Points, ZAxis=line)
divide_curve_2 = DivideCurve(Curve=circle_3, Count=10, Kinks=False)  # -> Points, Tangents, Parameters
list_item_2 = ListItem(List=divide_curve_2.Points, Index=0, Wrap=True)
circle_4 = Circle(Plane=plane_normal_2, Radius=number_slider_3)  # -> graft(Circle)
circle_5 = Circle(Plane=plane_normal, Radius=number_slider_3)  # -> graft(Circle)
xz_plane_2 = XZPlane(Origin=list_item_2)
number_slider_5 = Slider(40, range=0..50)
circle_6 = Circle(Plane=xz_plane_2, Radius=number_slider_3)
loft = Loft(
    Curves=[circle_5, circle_4],
    Options={Adjust=False, Closed=False, LoftEnds=0, LoftSimp=0, LoftType=0, Rebuild=10, Refit=0.01})
sweep1_2 = Sweep1(Rail=circle_3, Sections=circle_6, Miter=1)
mesh_surface = MeshSurface(Surface=[sweep1_2, loft, sweep1], UCount=number_slider_5, VCount=number_slider_5, Overhang=True, Equalize=False)
xz_plane_3 = XZPlane(Origin=Point(0, 0, 0))
polar_array = PolarArray(Geometry=mesh_surface, Plane=xz_plane_3, Count=number_slider_4, Angle=6.283185307)  # -> Geometry, Transform

# ---- group: RH_OUT:mesh
mesh = Mesh(polar_array.Geometry)
